# Grasshopper definition Foam(try).gh (Grasshopper 1.0.8)

box = Box({Plane=PlaneXY(0, 0, 0), X=Domain(0, 20), Y=Domain(0, 20), Z=Domain(0, 1)})
brep = Brep(box)
bbox = BoundingBox(Content=brep, Plane=PlaneXY(0, 0, 0))  # -> Box, Box_2
pop3d = Populate3D(Region=brep, Count=500, Seed=Slider(5, range=0..10))
voronoi³ = Voronoi3D(Points=pop3d, Box=bbox.Box)  # -> Cells, Boundary
debrep = DeconstructBrep(Brep=voronoi³.Cells)  # -> Faces, Edges, Vertices
pipe = Pipe(Curve=debrep.Edges, Radius=Slider(0.5, range=0..1), Caps=1, FitRail=False)
preview = CustomPreview(Geometry=pipe, Material=ColourSwatch(SwatchColor=RGB(255, 255, 255)))
