# Grasshopper definition foam.gh (Grasshopper 1.0.8)

box = Box({Plane=Plane(origin=(0, 20, 0), x=(1, 0, 0), y=(0, -1, 0)), X=Domain(0, 20), Y=Domain(0, 20), Z=Domain(-1, 0)})
pop3d = Populate3D(Region=box, Count=Slider(532, range=0..1000), Seed=1)
voronoi³ = Voronoi3D(Points=pop3d, Box=box)  # -> Cells, Boundary
volume = Volume(Geometry=voronoi³.Cells)  # -> Volume, Centroid
scale = Scale(Geometry=voronoi³.Cells, Center=volume.Centroid, Factor=Slider(0.95, range=0..1))  # -> Geometry, Transform
mesh = MeshBrep(
    Brep=scale.Geometry,
    Settings={GridMaxCount=0, GridMinCount=16, JaggedSeams=False, MaxEdgeLength=0, MinEdgeLength=0.0001, MinTolerance=0, Refine=True, RefineAngle=0, RelativeTolerance=0.65, SimplePlanes=True, Tolerance=0})
mdif = MeshDifference(MeshesA=box, MeshesB=mesh)
