# Grasshopper definition Voronoi project.gh (Grasshopper 1.0.8)

srf = Surface(<surface referenced from the Rhino model>)
pop2d = Populate2D(Region=srf, Count=Slider(120, range=1..120), Seed=Slider(10, range=1..50))
voronoi = Voronoi(Points=pop2d, Boundary=srf, BruteForceOverride=False)
area = Area(Geometry=voronoi)  # -> Area, Centroid
scale = Scale(Geometry=voronoi, Center=area.Centroid, Factor=Slider(0.8, range=0..1))  # -> Geometry, Transform
merge = Merge(Data1=scale.Geometry, Data2=voronoi)
boundary = BoundarySurfaces(Edges=merge)
Z = UnitZ(Factor=0.6)
extr = Extrude(Base=boundary, Direction=Z)
